# Grasshopper definition naca_airfoil.gh (Grasshopper 1.0.7)
# plug-ins: LunchBox

file = ReadFile(File="C:\Users\touze\project\wct24_shear_centre\NACA0025\naca0024.csv", PerLineParse=True)
pt = Point(file)
points = PointList(Points=file)
pline = PolyLine(Vertices=pt, Closed=True)
pcen = PolygonCenter(Polyline=pline)  # -> CenterV, CenterE, CenterA
intcrv = Interpolate(Vertices=pt, Degree=3, Periodic=False, KnotStyle=1)  # -> Curve, Length, Domain
vec = Vector(pcen.CenterE)
multiplication = Multiplication(A=vec, B=-1)
move = Move(Geometry=pline, Motion=multiplication)  # -> Geometry, Transform
scale = Scale(Geometry=move.Geometry, Center=Point(0, 0, 0), Factor=0.5)  # -> Geometry, Transform
offset = OffsetCurve(Curve=scale.Geometry, Distance=Slider(0.01, range=0..0.1), Corners=1)
offset_2 = OffsetCurve(Curve=scale.Geometry, Distance=Slider(-0.01, range=-0.01..0.1), Corners=1)
offset_3 = OffsetCurve(Curve=offset_2, Distance=Slider(0.005, range=0..0.05), Corners=1)
explode = Explode(Curve=offset_2, Recursive=True)  # -> Segments, Vertices
explode_2 = Explode(Curve=offset_3, Recursive=True)  # -> Segments, Vertices
csv = CreateCSV(DataGridHeaders="{x,y,z}", ValueTree=explode.Vertices, Delimiter=",")
pdecon = Deconstruct(Point=explode.Vertices)  # -> XComponent, YComponent, ZComponent
csv_2 = CreateCSV(DataGridHeaders="{x,y,z}", ValueTree=pdecon.XComponent, Delimiter=",")
datagrid = CreateDataGrid(DataGridHeaders="x", ValueTree=pdecon.YComponent)
